# Grasshopper definition auto_entourage.gh (Grasshopper 1.0.7)
# plug-ins: Python

path = FilePath("C:\Users\Vincent Mai\Desktop\Projects\speranza_architecture\auto_entourage\examples\entourages\entourages\")
path_2 = FilePath("C:\Users\Vincent Mai\Desktop\Projects\speranza_architecture\auto_entourage\examples\entourages\trimmed\")
qcrop = QuickCrop(in_path=path, out_path=path_2, crop=Toggle(False))
panel = Panel(qcrop)
pt = Point([<point referenced from the Rhino model> x6])
crv = Curve(<curve referenced from the Rhino model>)
aut_ent = AutoEntourage(path=path_2, img_height="5.7", region=crv, num="200", layer_name="entourage_01", place=Toggle(False))
